# Grasshopper definition addendum_one.ghx (Grasshopper 0.9.76)

number_slider = Slider(0.38, range=0..2)
number_slider_2 = Slider(0.83, range=0..2)
number_slider_3 = Slider(0.45, range=0..2)
number_slider_4 = Slider(0.7, range=0..2)
number_slider_5 = Slider(0.58, range=0..2)
number_slider_6 = Slider(1, range=0..6)
number_slider_7 = Slider(0, range=0..6)
number_slider_8 = Slider(2, range=0..6)
number_slider_9 = Slider(3, range=0..6)
pt = ConstructPoint(XCoordinate=number_slider_6, YCoordinate=number_slider_2, ZCoordinate=number_slider)
pt_2 = ConstructPoint(XCoordinate=number_slider_6, YCoordinate=number_slider_4, ZCoordinate=number_slider_3)
pt_3 = ConstructPoint(XCoordinate=number_slider_6, YCoordinate=Slider(0.503, range=0..2), ZCoordinate=Slider(0.963, range=0..2))
pt_4 = ConstructPoint(XCoordinate=number_slider_7, YCoordinate=number_slider_2, ZCoordinate=number_slider)
pt_5 = ConstructPoint(XCoordinate=number_slider_6, YCoordinate=number_slider_5, ZCoordinate=Slider(0.313, range=0..2))
pt_6 = ConstructPoint(XCoordinate=number_slider_7, YCoordinate=number_slider_4, ZCoordinate=number_slider_3)
pt_7 = ConstructPoint(XCoordinate=number_slider_7, YCoordinate=Slider(0.503, range=0..2), ZCoordinate=Slider(0.806, range=0..2))
pt_8 = ConstructPoint(XCoordinate=number_slider_6, YCoordinate=Slider(0.456, range=0..2), ZCoordinate=Slider(0.785, range=0..2))
pt_9 = ConstructPoint(XCoordinate=number_slider_7, YCoordinate=number_slider_5, ZCoordinate=Slider(0.305, range=0..2))
pt_10 = ConstructPoint(XCoordinate=number_slider_6, YCoordinate=Slider(0.426, range=0..2), ZCoordinate=Slider(0.591, range=0..2))
pt_11 = ConstructPoint(XCoordinate=number_slider_8, YCoordinate=number_slider_2, ZCoordinate=number_slider)
pt_12 = ConstructPoint(XCoordinate=number_slider_7, YCoordinate=Slider(0.446, range=0..2), ZCoordinate=Slider(0.702, range=0..2))
pt_13 = ConstructPoint(XCoordinate=number_slider_8, YCoordinate=number_slider_4, ZCoordinate=number_slider_3)
pt_14 = ConstructPoint(XCoordinate=number_slider_8, YCoordinate=Slider(0.523, range=0..2), ZCoordinate=Slider(0.762, range=0..2))
pt_15 = ConstructPoint(XCoordinate=number_slider_7, YCoordinate=Slider(0.47, range=0..2), ZCoordinate=Slider(0.563, range=0..2))
pt_16 = ConstructPoint(XCoordinate=number_slider_8, YCoordinate=number_slider_5, ZCoordinate=Slider(0.25, range=0..2))
pt_17 = ConstructPoint(XCoordinate=number_slider_9, YCoordinate=number_slider_2, ZCoordinate=number_slider)
pt_18 = ConstructPoint(XCoordinate=number_slider_8, YCoordinate=Slider(0.425, range=0..2), ZCoordinate=Slider(0.647, range=0..2))
pt_19 = ConstructPoint(XCoordinate=number_slider_8, YCoordinate=Slider(0.461, range=0..2), ZCoordinate=Slider(0.588, range=0..2))
pt_20 = ConstructPoint(XCoordinate=number_slider_9, YCoordinate=number_slider_4, ZCoordinate=number_slider_3)
pt_21 = ConstructPoint(XCoordinate=number_slider_9, YCoordinate=number_slider_5, ZCoordinate=Slider(0.213, range=0..2))
pt_22 = ConstructPoint(XCoordinate=number_slider_9, YCoordinate=Slider(0.535, range=0..2), ZCoordinate=Slider(0.7, range=0..2))
pt_23 = ConstructPoint(XCoordinate=number_slider_9, YCoordinate=Slider(0.546, range=0..2), ZCoordinate=Slider(0.983, range=0..2))
pt_24 = ConstructPoint(XCoordinate=number_slider_9, YCoordinate=Slider(0.313, range=0..2), ZCoordinate=Slider(1.027, range=0..2))
p_n_c = PickNChoose(Pattern=Toggle(False), Stream0=1, Stream1=3)
intcrv = Interpolate(Vertices=[pt_10, pt_5, pt, pt_2, pt_3, pt_8], Degree=p_n_c, Periodic=True, KnotStyle=1)  # -> Curve, Length, Domain
intcrv_2 = Interpolate(Vertices=[pt_15, pt_9, pt_4, pt_6, pt_7, pt_12], Degree=p_n_c, Periodic=True, KnotStyle=1)  # -> Curve, Length, Domain
intcrv_3 = Interpolate(Vertices=[pt_19, pt_16, pt_11, pt_13, pt_14, pt_18], Degree=p_n_c, Periodic=True, KnotStyle=1)  # -> Curve, Length, Domain
intcrv_4 = Interpolate(Vertices=[pt_24, pt_21, pt_17, pt_20, pt_22, pt_23], Degree=p_n_c, Periodic=True, KnotStyle=1)  # -> Curve, Length, Domain
range = Range(Domain=Domain(0, 3), Steps=60)
yz = YZPlane(Origin=Point(0, 0, 0))
pt_25 = ConstructPoint(XCoordinate=0, YCoordinate=Slider(0.662, range=0..2), ZCoordinate=Slider(0, range=0..2))
pt_26 = ConstructPoint(XCoordinate=0, YCoordinate=Slider(0, range=0..2), ZCoordinate=Slider(1.575, range=0..2))
X = UnitX(Factor=range)
yz_2 = YZPlane(Origin=Point(0, 0, 0))
ln = Line(StartPoint=pt_25, EndPoint=pt_26)
loft = Loft(
    Curves=[intcrv_2.Curve, intcrv.Curve, intcrv_3.Curve, intcrv_4.Curve],
    Options={Adjust=False, Closed=False, LoftEnds=0, LoftSimp=0, LoftType=0, Rebuild=10, Refit=0.01})
offset = Offset(Curve=ln, Distance=0.3, Plane=yz_2, Corners=1)
pt_27 = ConstructPoint(XCoordinate=0, YCoordinate=Slider(0.598, range=0..2), ZCoordinate=Slider(0.38, range=0..2))
pt_28 = ConstructPoint(XCoordinate=0, YCoordinate=Slider(0.884, range=0..2), ZCoordinate=Slider(0.45, range=0..2))
move = Move(Geometry=yz, Motion=X)  # -> Geometry, Transform
rec_2pt = Rectangle2Pt(Plane=yz_2, PointA=pt_27, PointB=pt_28, Radius=0)  # -> Rectangle, Length
X_2 = UnitX(Factor=number_slider_9)
extr = Extrude(Base=rec_2pt.Rectangle, Direction=X_2)
sec = BrepPlane(Brep=loft, Plane=move.Geometry)  # -> Curves, Points
move_2 = Move(Geometry=flatten(sec.Curves), Motion=Vector(0, 0, 10))  # -> Geometry, Transform
