# Grasshopper definition addendum_orient.ghx (Grasshopper 0.9.76)

number_slider = Slider(0.38, range=0..2)
number_slider_2 = Slider(0.83, range=0..2)
number_slider_3 = Slider(0.45, range=0..2)
number_slider_4 = Slider(0.7, range=0..2)
number_slider_5 = Slider(0.58, range=0..2)
number_slider_6 = Slider(1, range=0..6)
number_slider_7 = Slider(0, range=0..6)
number_slider_8 = Slider(2, range=0..6)
number_slider_9 = Slider(3, range=0..6)
pt = ConstructPoint(XCoordinate=number_slider_6, YCoordinate=number_slider_2, ZCoordinate=number_slider)
pt_2 = ConstructPoint(XCoordinate=number_slider_6, YCoordinate=number_slider_4, ZCoordinate=number_slider_3)
pt_3 = ConstructPoint(XCoordinate=number_slider_6, YCoordinate=Slider(0.503, range=0..2), ZCoordinate=Slider(0.963, range=0..2))
pt_4 = ConstructPoint(XCoordinate=number_slider_7, YCoordinate=number_slider_2, ZCoordinate=number_slider)
pt_5 = ConstructPoint(XCoordinate=number_slider_6, YCoordinate=number_slider_5, ZCoordinate=Slider(0.313, range=0..2))
pt_6 = ConstructPoint(XCoordinate=number_slider_7, YCoordinate=number_slider_4, ZCoordinate=number_slider_3)
pt_7 = ConstructPoint(XCoordinate=number_slider_7, YCoordinate=Slider(0.503, range=0..2), ZCoordinate=Slider(0.806, range=0..2))
pt_8 = ConstructPoint(XCoordinate=number_slider_6, YCoordinate=Slider(0.456, range=0..2), ZCoordinate=Slider(0.785, range=0..2))
pt_9 = ConstructPoint(XCoordinate=number_slider_7, YCoordinate=number_slider_5, ZCoordinate=Slider(0.305, range=0..2))
pt_10 = ConstructPoint(XCoordinate=number_slider_6, YCoordinate=Slider(0.426, range=0..2), ZCoordinate=Slider(0.591, range=0..2))
pt_11 = ConstructPoint(XCoordinate=number_slider_8, YCoordinate=number_slider_2, ZCoordinate=number_slider)
pt_12 = ConstructPoint(XCoordinate=number_slider_7, YCoordinate=Slider(0.446, range=0..2), ZCoordinate=Slider(0.702, range=0..2))
pt_13 = ConstructPoint(XCoordinate=number_slider_8, YCoordinate=number_slider_4, ZCoordinate=number_slider_3)
pt_14 = ConstructPoint(XCoordinate=number_slider_8, YCoordinate=Slider(0.523, range=0..2), ZCoordinate=Slider(0.762, range=0..2))
pt_15 = ConstructPoint(XCoordinate=number_slider_7, YCoordinate=Slider(0.47, range=0..2), ZCoordinate=Slider(0.563, range=0..2))
pt_16 = ConstructPoint(XCoordinate=number_slider_8, YCoordinate=number_slider_5, ZCoordinate=Slider(0.25, range=0..2))
pt_17 = ConstructPoint(XCoordinate=number_slider_9, YCoordinate=number_slider_2, ZCoordinate=number_slider)
pt_18 = ConstructPoint(XCoordinate=number_slider_8, YCoordinate=Slider(0.425, range=0..2), ZCoordinate=Slider(0.647, range=0..2))
pt_19 = ConstructPoint(XCoordinate=number_slider_8, YCoordinate=Slider(0.461, range=0..2), ZCoordinate=Slider(0.588, range=0..2))
pt_20 = ConstructPoint(XCoordinate=number_slider_9, YCoordinate=number_slider_4, ZCoordinate=number_slider_3)
pt_21 = ConstructPoint(XCoordinate=number_slider_9, YCoordinate=number_slider_5, ZCoordinate=Slider(0.213, range=0..2))
pt_22 = ConstructPoint(XCoordinate=number_slider_9, YCoordinate=Slider(0.535, range=0..2), ZCoordinate=Slider(0.7, range=0..2))
pt_23 = ConstructPoint(XCoordinate=number_slider_9, YCoordinate=Slider(0.546, range=0..2), ZCoordinate=Slider(0.983, range=0..2))
pt_24 = ConstructPoint(XCoordinate=number_slider_9, YCoordinate=Slider(0.313, range=0..2), ZCoordinate=Slider(1.027, range=0..2))
p_n_c = PickNChoose(Pattern=Toggle(False), Stream0=1, Stream1=3)
intcrv = Interpolate(Vertices=[pt_10, pt_5, pt, pt_2, pt_3, pt_8], Degree=p_n_c, Periodic=True, KnotStyle=1)  # -> Curve, Length, Domain
intcrv_2 = Interpolate(Vertices=[pt_15, pt_9, pt_4, pt_6, pt_7, pt_12], Degree=p_n_c, Periodic=True, KnotStyle=1)  # -> Curve, Length, Domain
intcrv_3 = Interpolate(Vertices=[pt_19, pt_16, pt_11, pt_13, pt_14, pt_18], Degree=p_n_c, Periodic=True, KnotStyle=1)  # -> Curve, Length, Domain
intcrv_4 = Interpolate(Vertices=[pt_24, pt_21, pt_17, pt_20, pt_22, pt_23], Degree=p_n_c, Periodic=True, KnotStyle=1)  # -> Curve, Length, Domain
range = Range(Domain=Domain(0, 3), Steps=60)
yz = YZPlane(Origin=Point(0, 0, 0))
pt_25 = ConstructPoint(XCoordinate=0, YCoordinate=Slider(0.662, range=0..2), ZCoordinate=Slider(0, range=0..2))
pt_26 = ConstructPoint(XCoordinate=0, YCoordinate=Slider(0, range=0..2), ZCoordinate=Slider(1.575, range=0..2))
X = UnitX(Factor=range)
yz_2 = YZPlane(Origin=Point(0, 0, 0))
ln = Line(StartPoint=pt_25, EndPoint=pt_26)
multiplication = Multiplication(A=range, B=Slider(6.854, range=0..10))
loft = Loft(
    Curves=[intcrv_2.Curve, intcrv.Curve, intcrv_3.Curve, intcrv_4.Curve],
    Options={Adjust=False, Closed=False, LoftEnds=0, LoftSimp=0, LoftType=0, Rebuild=10, Refit=0.01})
offset = Offset(Curve=ln, Distance=0.3, Plane=yz_2, Corners=1)
pt_27 = ConstructPoint(XCoordinate=0, YCoordinate=Slider(0.598, range=0..2), ZCoordinate=Slider(0.38, range=0..2))
pt_28 = ConstructPoint(XCoordinate=0, YCoordinate=Slider(0.884, range=0..2), ZCoordinate=Slider(0.465, range=0..2))
move = Move(Geometry=yz, Motion=X)  # -> Geometry, Transform
Y = UnitY(Factor=multiplication)
rec_2pt = Rectangle2Pt(Plane=yz_2, PointA=pt_27, PointB=pt_28, Radius=0)  # -> Rectangle, Length
cap = CapHoles(Brep=loft)
X_2 = UnitX(Factor=number_slider_9)
extr = Extrude(Base=rec_2pt.Rectangle, Direction=X_2)
cap_2 = CapHoles(Brep=extr)
sdiff = SolidDifference(BrepsA=cap, BrepsB=cap_2)
sec = BrepPlane(Brep=sdiff, Plane=move.Geometry)  # -> Curves, Points
yz_3 = YZPlane(Origin=Point(0, 0, 0))
pt_29 = ConstructPoint(XCoordinate=0, YCoordinate=Slider(0.561, range=0..2), ZCoordinate=Slider(0.493, range=0..2))
yz_4 = YZPlane(Origin=Point(0, 0, 0))
pt_30 = ConstructPoint(XCoordinate=0, YCoordinate=Slider(0.603, range=0..2), ZCoordinate=Slider(0.352, range=0..2))
yz_5 = YZPlane(Origin=Point(0, 0, 0))
circle = CircleCNR(Center=pt_29, Normal=yz_3, Radius=Slider(0.005, range=0..1))
pt_31 = ConstructPoint(XCoordinate=0, YCoordinate=Slider(0.524, range=0..2), ZCoordinate=Slider(0.614, range=0..2))
circle_2 = CircleCNR(Center=pt_30, Normal=yz_4, Radius=Slider(0.005, range=0..1))
circle_3 = CircleCNR(Center=pt_31, Normal=yz_5, Radius=Slider(0.005, range=0..1))
move_2 = Move(Geometry=flatten(sec.Curves), Motion=Y)  # -> Geometry, Transform
move_3 = Move(Geometry=graft([circle_3, circle, circle_2]), Motion=Y)  # -> Geometry, Transform
extr_2 = Extrude(Base=flatten([circle_3, circle, circle_2]), Direction=X_2)
yz_6 = YZPlane(Origin=Point(0, 0, 0))
xy = XYPlane(Origin=Point(0, 0, 0))
range_2 = Range(Domain=Domain(0, 60), Steps=60)
round = Round(Number=range_2)  # -> Nearest, Floor, Ceiling
X_3 = UnitX(Factor=multiplication)
pt_32 = ConstructPoint(XCoordinate=Slider(0.575, range=0..2), YCoordinate=Slider(0.427, range=0..2), ZCoordinate=0)
move_4 = Move(Geometry=pt_32, Motion=X_3)  # -> Geometry, Transform
tag = TextTag3D(Location=move_4.Geometry, Text=round.Nearest, Size=Slider(0.014, range=0..1), Justification=5)
orient = Orient(Geometry=[move_2.Geometry, move_3.Geometry], Source=yz_6, Target=xy)  # -> Geometry, Transform
