# Grasshopper definition addendum_two.ghx (Grasshopper 0.9.76)

number_slider = Slider(0.961, range=0..2)
number_slider_2 = Slider(0.47, range=0..2)
y = Slider(0.7, range=0..2)
z = Slider(0.47, range=0..2)
y_2 = Slider(0.965, range=0..2)
y_3 = Slider(0.585, range=0..2)
z_2 = Slider(0.335, range=0..2)
y_4 = Slider(0.503, range=0..2)
z_3 = Slider(0.507, range=0..2)
y_5 = Slider(0.54, range=0..2)
z_4 = Slider(0.372, range=0..2)
y_6 = Slider(0.426, range=0..2)
z_5 = Slider(0.362, range=0..2)
z_6 = Slider(0.366, range=0..2)
y_7 = Slider(0.503, range=0..2)
z_7 = Slider(0.653, range=0..2)
y_8 = Slider(0.456, range=0..2)
z_8 = Slider(0.617, range=0..2)
y_9 = Slider(0.461, range=0..2)
z_9 = Slider(0.3, range=0..2)
z_10 = Slider(0.358, range=0..2)
y_10 = Slider(0.523, range=0..2)
z_11 = Slider(0.669, range=0..2)
y_11 = Slider(0.425, range=0..2)
z_12 = Slider(0.647, range=0..2)
y_12 = Slider(0.533, range=0..2)
z_13 = Slider(0.351, range=0..2)
z_14 = Slider(0.352, range=0..2)
y_13 = Slider(0.493, range=0..2)
z_15 = Slider(0.849, range=0..2)
y_14 = Slider(0.427, range=0..2)
z_16 = Slider(0.651, range=0..2)
z_17 = Slider(0.322, range=0..2)

pt = ConstructPoint(XCoordinate="0", YCoordinate=y_3, ZCoordinate=z_2)
pt_2 = ConstructPoint(XCoordinate="0", YCoordinate=y_2, ZCoordinate=z_17)
pt_3 = ConstructPoint(XCoordinate="0", YCoordinate=number_slider, ZCoordinate=number_slider_2)
pt_4 = ConstructPoint(XCoordinate="0", YCoordinate=y, ZCoordinate=z)
pt_5 = ConstructPoint(XCoordinate="0", YCoordinate=y_4, ZCoordinate=z_3)
pt_6 = ConstructPoint(XCoordinate="0", YCoordinate=y_5, ZCoordinate=z_4)

pt_7 = ConstructPoint(XCoordinate="2.00", YCoordinate=y_9, ZCoordinate=z_9)
pt_8 = ConstructPoint(XCoordinate="2.00", YCoordinate=y_2, ZCoordinate=z_10)
pt_9 = ConstructPoint(XCoordinate="2.00", YCoordinate=number_slider, ZCoordinate=number_slider_2)
pt_10 = ConstructPoint(XCoordinate="2.00", YCoordinate=y, ZCoordinate=z)
pt_11 = ConstructPoint(XCoordinate="2.00", YCoordinate=y_10, ZCoordinate=z_11)
pt_12 = ConstructPoint(XCoordinate="2.00", YCoordinate=y_11, ZCoordinate=z_12)

pt_13 = ConstructPoint(XCoordinate="3.00", YCoordinate=y_12, ZCoordinate=z_13)
pt_14 = ConstructPoint(XCoordinate="3.00", YCoordinate=y_2, ZCoordinate=z_14)
pt_15 = ConstructPoint(XCoordinate="3.00", YCoordinate=number_slider, ZCoordinate=number_slider_2)
pt_16 = ConstructPoint(XCoordinate="3.00", YCoordinate=y, ZCoordinate=z)
pt_17 = ConstructPoint(XCoordinate="3.00", YCoordinate=y_13, ZCoordinate=z_15)
pt_18 = ConstructPoint(XCoordinate="3.00", YCoordinate=y_14, ZCoordinate=z_16)

pt_19 = ConstructPoint(XCoordinate="1.00", YCoordinate=y_6, ZCoordinate=z_5)
pt_20 = ConstructPoint(XCoordinate="1.00", YCoordinate=y_2, ZCoordinate=z_6)
pt_21 = ConstructPoint(XCoordinate="1.00", YCoordinate=number_slider, ZCoordinate=number_slider_2)
pt_22 = ConstructPoint(XCoordinate="1.00", YCoordinate=y, ZCoordinate=z)
pt_23 = ConstructPoint(XCoordinate="1.00", YCoordinate=y_7, ZCoordinate=z_7)
pt_24 = ConstructPoint(XCoordinate="1.00", YCoordinate=y_8, ZCoordinate=z_8)

p_n_c = PickNChoose(Pattern=Toggle(False), Stream0=1, Stream1=3)

# ---- group: Limite
y_15 = Slider(0.662, range=0..2)
z_18 = Slider(0, range=0..2)
y_16 = Slider(0, range=0..2)
z_19 = Slider(1.575, range=0..2)
pt_25 = ConstructPoint(XCoordinate=0, YCoordinate=y_15, ZCoordinate=z_18)
pt_26 = ConstructPoint(XCoordinate=0, YCoordinate=y_16, ZCoordinate=z_19)
yz = YZPlane(Origin=Point(0, 0, 0))
ln = Line(StartPoint=pt_25, EndPoint=pt_26)
offset = Offset(Curve=ln, Distance=0.3, Plane=yz, Corners=1)

# ----
intcrv = Interpolate(Vertices=[pt, pt_2, pt_3, pt_4, pt_5, pt_6], Degree=p_n_c, Periodic=True, KnotStyle=1)  # -> Curve, Length, Domain
intcrv_2 = Interpolate(Vertices=[pt_19, pt_20, pt_21, pt_22, pt_23, pt_24], Degree=p_n_c, Periodic=True, KnotStyle=1)  # -> Curve, Length, Domain
intcrv_3 = Interpolate(Vertices=[pt_7, pt_8, pt_9, pt_10, pt_11, pt_12], Degree=p_n_c, Periodic=True, KnotStyle=1)  # -> Curve, Length, Domain
intcrv_4 = Interpolate(Vertices=[pt_13, pt_14, pt_15, pt_16, pt_17, pt_18], Degree=p_n_c, Periodic=True, KnotStyle=1)  # -> Curve, Length, Domain

loft = Loft(
    Curves=[intcrv.Curve, intcrv_2.Curve, intcrv_3.Curve, intcrv_4.Curve],
    Options={Adjust=False, Closed=False, LoftEnds=0, LoftSimp=0, LoftType=0, Rebuild=10, Refit=0.01})
range = Range(Domain=Domain(0, 3), Steps=80)
yz_2 = YZPlane(Origin=Point(0, 0, 0))
X = UnitX(Factor=range)
espessura_mdf = Slider(0.03, range=0..1)
addition = Addition(A="3.00", B=espessura_mdf)
panel = Panel(addition)
move = Move(Geometry=yz_2, Motion=X)  # -> Geometry, Transform
sec = BrepPlane(Brep=loft, Plane=move.Geometry)  # -> Curves, Points
debrep = DeconstructBrep(Brep=sec.Curves)  # -> Faces, Edges, Vertices
X_2 = UnitX(Factor=espessura_mdf)
extr = Extrude(Base=debrep.Faces, Direction=X_2)

# ---- group: Largura
number_slider_3 = Slider(0.598, range=0..2)
number_slider_4 = Slider(0.948, range=0..2)

# ----
subtraction = Subtraction(A=number_slider_4, B=number_slider_3)

# ---- group: Largura (continued)
panel_2 = Panel(subtraction)

# ---- group: Diâmetro
number_slider_5 = Slider(0.38, range=0..2)
number_slider_6 = Slider(0.45, range=0..2)

# ---- group: Banco
pt_27 = ConstructPoint(XCoordinate=0, YCoordinate=number_slider_3, ZCoordinate=number_slider_5)
pt_28 = ConstructPoint(XCoordinate=0, YCoordinate=number_slider_4, ZCoordinate=number_slider_6)
rec_2pt = Rectangle2Pt(Plane=yz, PointA=pt_27, PointB=pt_28, Radius=0)  # -> Rectangle, Length
X_3 = UnitX(Factor=addition)
extr_2 = Extrude(Base=rec_2pt.Rectangle, Direction=X_3)

# ----
subtraction_2 = Subtraction(A=number_slider_6, B=number_slider_5)

# ---- group: Diâmetro (continued)
panel_3 = Panel(subtraction_2)
