# Grasshopper definition bench_int.ghx (Grasshopper 0.9.76)

number_slider = Slider(1, range=0..6)
number_slider_2 = Slider(0, range=0..6)
number_slider_3 = Slider(2, range=0..6)
number_slider_4 = Slider(3, range=0..6)
number_slider_5 = Slider(0, range=0..6)
number_slider_6 = Slider(1, range=0..6)
number_slider_7 = Slider(2, range=0..6)
number_slider_8 = Slider(3, range=0..6)
pt = ConstructPoint(XCoordinate=number_slider_2, YCoordinate=Slider(0.47, range=0..2), ZCoordinate=Slider(0.563, range=0..2))
pt_2 = ConstructPoint(XCoordinate=number_slider_2, YCoordinate=Slider(0.693, range=0..2), ZCoordinate=0)
pt_3 = ConstructPoint(XCoordinate=number_slider_2, YCoordinate=Slider(0.937, range=0..2), ZCoordinate=0)
pt_4 = ConstructPoint(XCoordinate=number_slider_2, YCoordinate=Slider(0.601, range=0..2), ZCoordinate=Slider(0.539, range=0..2))
pt_5 = ConstructPoint(XCoordinate=number_slider_2, YCoordinate=Slider(0.503, range=0..2), ZCoordinate=Slider(0.806, range=0..2))
pt_6 = ConstructPoint(XCoordinate=number_slider_2, YCoordinate=Slider(0.446, range=0..2), ZCoordinate=Slider(0.702, range=0..2))
pt_7 = ConstructPoint(XCoordinate=number_slider, YCoordinate=Slider(0.426, range=0..2), ZCoordinate=Slider(0.591, range=0..2))
pt_8 = ConstructPoint(XCoordinate=number_slider, YCoordinate=Slider(0.7, range=0..2), ZCoordinate=0)
pt_9 = ConstructPoint(XCoordinate=number_slider, YCoordinate=Slider(0.886, range=0..2), ZCoordinate=0)
pt_10 = ConstructPoint(XCoordinate=number_slider, YCoordinate=Slider(0.639, range=0..2), ZCoordinate=Slider(0.497, range=0..2))
pt_11 = ConstructPoint(XCoordinate=number_slider, YCoordinate=Slider(0.503, range=0..2), ZCoordinate=Slider(0.963, range=0..2))
pt_12 = ConstructPoint(XCoordinate=number_slider, YCoordinate=Slider(0.456, range=0..2), ZCoordinate=Slider(0.785, range=0..2))
pt_13 = ConstructPoint(XCoordinate=number_slider_3, YCoordinate=Slider(0.461, range=0..2), ZCoordinate=Slider(0.595, range=0..2))
pt_14 = ConstructPoint(XCoordinate=number_slider_3, YCoordinate=Slider(0.711, range=0..2), ZCoordinate=0)
pt_15 = ConstructPoint(XCoordinate=number_slider_3, YCoordinate=Slider(0.918, range=0..2), ZCoordinate=0)
pt_16 = ConstructPoint(XCoordinate=number_slider_3, YCoordinate=Slider(0.512, range=0..2), ZCoordinate=Slider(0.62, range=0..2))
pt_17 = ConstructPoint(XCoordinate=number_slider_3, YCoordinate=Slider(0.523, range=0..2), ZCoordinate=Slider(0.762, range=0..2))
pt_18 = ConstructPoint(XCoordinate=number_slider_3, YCoordinate=Slider(0.425, range=0..2), ZCoordinate=Slider(0.647, range=0..2))
pt_19 = ConstructPoint(XCoordinate=number_slider_4, YCoordinate=Slider(0.464, range=0..2), ZCoordinate=Slider(0.558, range=0..2))
pt_20 = ConstructPoint(XCoordinate=number_slider_4, YCoordinate=Slider(0.675, range=0..2), ZCoordinate=0)
pt_21 = ConstructPoint(XCoordinate=number_slider_4, YCoordinate=Slider(0.846, range=0..2), ZCoordinate=0)
pt_22 = ConstructPoint(XCoordinate=number_slider_4, YCoordinate=Slider(0.576, range=0..2), ZCoordinate=Slider(0.523, range=0..2))
pt_23 = ConstructPoint(XCoordinate=number_slider_4, YCoordinate=Slider(0.551, range=0..2), ZCoordinate=Slider(1.012, range=0..2))
pt_24 = ConstructPoint(XCoordinate=number_slider_4, YCoordinate=Slider(0.489, range=0..2), ZCoordinate=Slider(0.891, range=0..2))
pt_25 = ConstructPoint(XCoordinate=number_slider_5, YCoordinate=Slider(0.563, range=0..2), ZCoordinate=Slider(0.218, range=0..2))
pt_26 = ConstructPoint(XCoordinate=number_slider_5, YCoordinate=Slider(0.263, range=0..2), ZCoordinate=0)
pt_27 = ConstructPoint(XCoordinate=number_slider_5, YCoordinate=Slider(0.56, range=0..2), ZCoordinate=0)
pt_28 = ConstructPoint(XCoordinate=number_slider_5, YCoordinate=Slider(0.995, range=0..2), ZCoordinate=Slider(0.419, range=0..2))
pt_29 = ConstructPoint(XCoordinate=number_slider_5, YCoordinate=Slider(0.676, range=0..2), ZCoordinate=Slider(0.408, range=0..2))
pt_30 = ConstructPoint(XCoordinate=number_slider_5, YCoordinate=Slider(0.656, range=0..2), ZCoordinate=Slider(0.351, range=0..2))
pt_31 = ConstructPoint(XCoordinate=number_slider_6, YCoordinate=Slider(0.56, range=0..2), ZCoordinate=Slider(0.208, range=0..2))
pt_32 = ConstructPoint(XCoordinate=number_slider_6, YCoordinate=Slider(0.215, range=0..2), ZCoordinate=0)
pt_33 = ConstructPoint(XCoordinate=number_slider_6, YCoordinate=Slider(0.473, range=0..2), ZCoordinate=0)
pt_34 = ConstructPoint(XCoordinate=number_slider_6, YCoordinate=Slider(0.969, range=0..2), ZCoordinate=Slider(0.43, range=0..2))
pt_35 = ConstructPoint(XCoordinate=number_slider_6, YCoordinate=Slider(0.634, range=0..2), ZCoordinate=Slider(0.416, range=0..2))
pt_36 = ConstructPoint(XCoordinate=number_slider_6, YCoordinate=Slider(0.57, range=0..2), ZCoordinate=Slider(0.34, range=0..2))
pt_37 = ConstructPoint(XCoordinate=number_slider_7, YCoordinate=Slider(0.406, range=0..2), ZCoordinate=Slider(0.213, range=0..2))
pt_38 = ConstructPoint(XCoordinate=number_slider_7, YCoordinate=Slider(0.25, range=0..2), ZCoordinate=0)
pt_39 = ConstructPoint(XCoordinate=number_slider_7, YCoordinate=Slider(0.55, range=0..2), ZCoordinate=0)
pt_40 = ConstructPoint(XCoordinate=number_slider_7, YCoordinate=Slider(0.99, range=0..2), ZCoordinate=Slider(0.436, range=0..2))
pt_41 = ConstructPoint(XCoordinate=number_slider_7, YCoordinate=Slider(0.637, range=0..2), ZCoordinate=Slider(0.373, range=0..2))
pt_42 = ConstructPoint(XCoordinate=number_slider_7, YCoordinate=Slider(0.522, range=0..2), ZCoordinate=Slider(0.305, range=0..2))
pt_43 = ConstructPoint(XCoordinate=number_slider_8, YCoordinate=Slider(0.476, range=0..2), ZCoordinate=Slider(0.201, range=0..2))
pt_44 = ConstructPoint(XCoordinate=number_slider_8, YCoordinate=Slider(0.341, range=0..2), ZCoordinate=0)
pt_45 = ConstructPoint(XCoordinate=number_slider_8, YCoordinate=Slider(0.584, range=0..2), ZCoordinate=0)
pt_46 = ConstructPoint(XCoordinate=number_slider_8, YCoordinate=Slider(0.953, range=0..2), ZCoordinate=Slider(0.422, range=0..2))
pt_47 = ConstructPoint(XCoordinate=number_slider_8, YCoordinate=Slider(0.662, range=0..2), ZCoordinate=Slider(0.418, range=0..2))
pt_48 = ConstructPoint(XCoordinate=number_slider_8, YCoordinate=Slider(0.492, range=0..2), ZCoordinate=Slider(0.28, range=0..2))
p_n_c = PickNChoose(Pattern=Toggle(False), Stream0=1, Stream1=3)
p_n_c_2 = PickNChoose(Pattern=Toggle(False), Stream0=1, Stream1=3)
intcrv = Interpolate(Vertices=[pt, pt_2, pt_3, pt_4, pt_5, pt_6], Degree=p_n_c, Periodic=True, KnotStyle=1)  # -> Curve, Length, Domain
intcrv_2 = Interpolate(Vertices=[pt_7, pt_8, pt_9, pt_10, pt_11, pt_12], Degree=p_n_c, Periodic=True, KnotStyle=1)  # -> Curve, Length, Domain
intcrv_3 = Interpolate(Vertices=[pt_13, pt_14, pt_15, pt_16, pt_17, pt_18], Degree=p_n_c, Periodic=True, KnotStyle=1)  # -> Curve, Length, Domain
intcrv_4 = Interpolate(Vertices=[pt_19, pt_20, pt_21, pt_22, pt_23, pt_24], Degree=p_n_c, Periodic=True, KnotStyle=1)  # -> Curve, Length, Domain
range = Range(Domain=Domain(0, 3), Steps=60)
intcrv_5 = Interpolate(Vertices=[pt_25, pt_26, pt_27, pt_28, pt_29, pt_30], Degree=p_n_c_2, Periodic=True, KnotStyle=1)  # -> Curve, Length, Domain
intcrv_6 = Interpolate(Vertices=[pt_31, pt_32, pt_33, pt_34, pt_35, pt_36], Degree=p_n_c_2, Periodic=True, KnotStyle=1)  # -> Curve, Length, Domain
intcrv_7 = Interpolate(Vertices=[pt_37, pt_38, pt_39, pt_40, pt_41, pt_42], Degree=p_n_c_2, Periodic=True, KnotStyle=1)  # -> Curve, Length, Domain
intcrv_8 = Interpolate(Vertices=[pt_43, pt_44, pt_45, pt_46, pt_47, pt_48], Degree=p_n_c_2, Periodic=True, KnotStyle=1)  # -> Curve, Length, Domain
yz = YZPlane(Origin=Point(0, 0, 0))
pt_49 = ConstructPoint(XCoordinate=0, YCoordinate=Slider(0.662, range=0..2), ZCoordinate=Slider(0, range=0..2))
pt_50 = ConstructPoint(XCoordinate=0, YCoordinate=Slider(0, range=0..2), ZCoordinate=Slider(1.575, range=0..2))
range_2 = Range(Domain=Domain(0, 3), Steps=60)
X = UnitX(Factor=range)
yz_2 = YZPlane(Origin=Point(0, 0, 0))
yz_3 = YZPlane(Origin=Point(0, 0, 0))
pt_51 = ConstructPoint(XCoordinate=0, YCoordinate=Slider(0.17, range=0..2), ZCoordinate=Slider(0, range=0..2))
pt_52 = ConstructPoint(XCoordinate=0, YCoordinate=Slider(1.712, range=0..2), ZCoordinate=Slider(1.456, range=0..2))
ln = Line(StartPoint=pt_49, EndPoint=pt_50)
X_2 = UnitX(Factor=range_2)
loft = Loft(
    Curves=[intcrv.Curve, intcrv_2.Curve, intcrv_3.Curve, intcrv_4.Curve],
    Options={Adjust=False, Closed=False, LoftEnds=0, LoftSimp=0, LoftType=0, Rebuild=10, Refit=0.01})
offset = Offset(Curve=ln, Distance=0.3, Plane=yz_3, Corners=1)
yz_4 = YZPlane(Origin=Point(0, 0, 0))
ln_2 = Line(StartPoint=pt_51, EndPoint=pt_52)
move = Move(Geometry=yz, Motion=X)  # -> Geometry, Transform
loft_2 = Loft(
    Curves=[intcrv_5.Curve, intcrv_6.Curve, intcrv_7.Curve, intcrv_8.Curve],
    Options={Adjust=False, Closed=False, LoftEnds=0, LoftSimp=0, LoftType=0, Rebuild=10, Refit=0.01})
offset_2 = Offset(Curve=ln_2, Distance=0.3, Plane=yz_4, Corners=1)
move_2 = Move(Geometry=yz_2, Motion=X_2)  # -> Geometry, Transform
X_3 = UnitX(Factor=number_slider_8)
sec = BrepPlane(Brep=loft, Plane=move.Geometry)  # -> Curves, Points
sec_2 = BrepPlane(Brep=loft_2, Plane=move_2.Geometry)  # -> Curves, Points
move_3 = Move(Geometry=flatten(sec.Curves), Motion=Vector(0, 0, 10))  # -> Geometry, Transform
move_4 = Move(Geometry=flatten(sec_2.Curves), Motion=Vector(0, 0, 10))  # -> Geometry, Transform
